# Grasshopper definition PavilionOne.gh (Grasshopper 0.9.76)
# plug-ins: PTComponentLibrary, Kangaroo2 Components

# ---- group: XTranslationControlWatchOutItShouldMatchTheTranslationsThatAreBelowCheckByViewingTheRedWatchOutGroupToTheRight
number_slider = Slider(17, range=0..30)

# ----
number_slider_2 = Slider(2.1638, range=0..10)

# ---- group: GridFourOurValleysAndMountains
planar_grid = PlanarGrid(
    BasePoint=Point(0, 0, 0),
    IDir=Vector(1, 0, 0),
    JDir=Vector(0, 1, 0),
    IDistance=number_slider_2,
    JDistance=1.5,
    INumber=6,
    JNumber=number_slider)  # -> simplify(Grid)

# ---- group: ParametricMagicThanksRelativeItem
boolean_toggle = BooleanToggle(False)
flip_matrix = FlipMatrix(Data=planar_grid)
relative_item = RelativeItem(Tree=planar_grid, Offset="{0}[+1]", WrapPaths=boolean_toggle, WrapItems=boolean_toggle)  # -> ItemA, ItemB
relative_item_2 = RelativeItem(Tree=flip_matrix, Offset="{0}[+1]", WrapPaths=boolean_toggle, WrapItems=boolean_toggle)  # -> ItemA, ItemB
relative_item_3 = RelativeItem(Tree=planar_grid, Offset="{+1}[+1]", WrapPaths=boolean_toggle, WrapItems=boolean_toggle)  # -> ItemA, ItemB
relative_item_4 = RelativeItem(Tree=planar_grid, Offset="{+1}[-1]", WrapPaths=boolean_toggle, WrapItems=boolean_toggle)  # -> ItemA, ItemB
line = Line(StartPoint=relative_item.ItemA, EndPoint=relative_item.ItemB)
line_2 = Line(StartPoint=relative_item_4.ItemA, EndPoint=relative_item_4.ItemB)
line_3 = Line(StartPoint=relative_item_2.ItemA, EndPoint=relative_item_2.ItemB)
line_4 = Line(StartPoint=relative_item_3.ItemA, EndPoint=relative_item_3.ItemB)
boolean_toggle_2 = BooleanToggle(False)
relative_item_5 = RelativeItem(Tree=line_4, Offset="{+2}[0]", WrapPaths=boolean_toggle_2, WrapItems=boolean_toggle_2)  # -> ItemA, ItemB
relative_item_6 = RelativeItem(Tree=line_2, Offset="{+2}[0]", WrapPaths=boolean_toggle_2, WrapItems=boolean_toggle_2)  # -> ItemA, ItemB
boolean_toggle_3 = BooleanToggle(False)
line_5 = Line(relative_item_6.ItemB)
line_6 = Line(relative_item_6.ItemA)
line_7 = Line(relative_item_5.ItemB)
line_8 = Line(relative_item_5.ItemA)
relative_item_7 = RelativeItem(Tree=line_8, Offset="{+1}[0]", WrapPaths=boolean_toggle_3, WrapItems=boolean_toggle_3)  # -> ItemA, ItemB
relative_item_8 = RelativeItem(Tree=line_7, Offset="{+1}[0]", WrapPaths=boolean_toggle_3, WrapItems=boolean_toggle_3)  # -> ItemA, ItemB
relative_item_9 = RelativeItem(Tree=line_6, Offset="{+1}[0]", WrapPaths=boolean_toggle_3, WrapItems=boolean_toggle_3)  # -> ItemA, ItemB
relative_item_10 = RelativeItem(Tree=line_5, Offset="{+1}[0]", WrapPaths=boolean_toggle_3, WrapItems=boolean_toggle_3)  # -> ItemA, ItemB
line_9 = Line(relative_item_8.ItemA)
line_10 = Line(relative_item_10.ItemA)
line_11 = Line(relative_item_7.ItemB)
line_12 = Line(relative_item_9.ItemB)
cull_pattern = CullPattern(List=line_11, CullPattern=[False, True])
cull_pattern_2 = CullPattern(List=line_9, CullPattern=invert([False, True]))
cull_pattern_3 = CullPattern(List=line_12, CullPattern=invert([False, True]))
cull_pattern_4 = CullPattern(List=line_10, CullPattern=[False, True])
flip_matrix_2 = FlipMatrix(Data=cull_pattern)
flip_matrix_3 = FlipMatrix(Data=cull_pattern_2)
flip_matrix_4 = FlipMatrix(Data=cull_pattern_3)
flip_matrix_5 = FlipMatrix(Data=cull_pattern_4)

# ---- group: SetUpOurMeshAndTheTranslations / YTranslationControl
number_slider_3 = Slider(1, range=0..10)

# ---- group: SetUpOurMeshAndTheTranslations
planar_grid_2 = PlanarGrid(
    BasePoint=Point(0, 0, 0),
    IDir=Vector(1, 0, 0),
    JDir=Vector(0, 1, 0),
    IDistance=number_slider_2,
    JDistance=1.5,
    INumber=6,
    JNumber=3)  # -> simplify(Grid)
list_item = ListItem(List=flatten(planar_grid_2), Index=0, Wrap=True)  # -> Item, Item1, Item2
distance = Distance(PointA=list_item.Item, PointB=list_item.Item2)
meshertree = CSharpScript(points=flatten(planar_grid_2))  # -> simplify(meshOut); inputs points: tree of Point3d
# ---------- meshertree: C# ----------
    int size = points.BranchCount;

    var mesh = new Mesh[size];

    var organized = new Point3d[size][];

    for( int i = 0; i < size; ++i )
    {

      mesh[i] = new Mesh();
      mesh[i].Vertices.AddVertices(points.Branch(i));

      mesh[i].Faces.AddFace(0, 1, 4, 6);
      mesh[i].Faces.AddFace(4, 13, 9, 6);
      mesh[i].Faces.AddFace(13, 16, 15, 9);
      mesh[i].Faces.AddFace(1, 2, 8, 4);
      mesh[i].Faces.AddFace(8, 11, 13, 4);
      mesh[i].Faces.AddFace(11, 17, 16, 13);
      
      /*
      mesh[i].Faces.AddFace(9, 1, 6);
      mesh[i].Faces.AddFace(9, 10, 1);
      mesh[i].Faces.AddFace(1, 10, 11);
      mesh[i].Faces.AddFace(1, 11, 8);
      mesh[i].Faces.AddFace(8, 7, 0, 1);
      mesh[i].Faces.AddFace(1, 0, 5, 6);
      mesh[i].Faces.AddFace(0, 7, 4);
      mesh[i].Faces.AddFace(0, 4, 3);
      mesh[i].Faces.AddFace(0, 3, 2);
      mesh[i].Faces.AddFace(0, 2, 5);
      */

    }

    meshOut = mesh;
# ---------- end meshertree ----------
series = Series(Start=0, Step=distance, Count=expr("x*0.5", number_slider))
unit_x = UnitX(Factor=series)
list_item_2 = ListItem(List=flatten(planar_grid_2), Index=Slider(33, range=0..100), Wrap=True)
list_item_3 = ListItem(List=flatten(planar_grid_2), Index=Slider(0, range=0..10), Wrap=True)
move = Move(Geometry=meshertree, Motion=unit_x)  # -> Geometry, Transform
distance_2 = Distance(PointA=list_item_3, PointB=list_item_2)
weld_mesh = WeldMesh(Mesh=move.Geometry, Angle=3.141592654)
series_2 = Series(Start=0, Step=distance_2, Count=number_slider_3)
mesh_join = MeshJoin(Meshes=weld_mesh)
unit_y = UnitY(Factor=series_2)
move_2 = Move(Geometry=mesh_join, Motion=unit_y)  # -> Geometry, Transform
mesh_join_2 = MeshJoin(Meshes=move_2.Geometry)
mesh_edges = MeshEdges(Mesh=mesh_join_2)  # -> NakedEdges, InteriorEdges, NonManifoldEdges
curve = Curve(mesh_edges.NakedEdges)

# ---- group: GetAllTheValleysAndMountains
centerlines = CSharpScript(lines=line_3)  # -> linesOut; inputs lines: tree of Line
# ---------- centerlines: C# ----------
    var lineTree = new DataTree<Line>();
    
    for( int i = 0; i < lines.BranchCount; ++i )
      for( int j = 1; j < lines.Branch(i).Count - 1; ++j )
      {
      
        if( i % 2 != 0 )
        lineTree.Add( lines.Branch(i)[j], new GH_Path(i) );
        
      }
    
    linesOut = lineTree;
# ---------- end centerlines ----------
topbottomlines = CSharpScript(lines=line_3)  # -> linesOut; inputs lines: tree of Line
# ---------- topbottomlines: C# ----------
    var lineTree = new DataTree<Line>();

    for( int i = 0; i < lines.BranchCount; ++i )
      for( int j = 2; j < lines.Branch(i).Count - 2; ++j )
      {

        if( i % 2 != 1 )
          lineTree.Add(lines.Branch(i)[j], new GH_Path(i));

      }

    linesOut = lineTree;
# ---------- end topbottomlines ----------
rightcenterlines = CSharpScript(lines=line_3)  # -> linesOut; inputs lines: tree of Line
# ---------- rightcenterlines: C# ----------
    var lineTree = new DataTree<Line>();

    for( int i = 0; i < lines.BranchCount; ++i )
      for( int j = 0; j < lines.Branch(i).Count - 4; ++j )
      {

        if( i % 2 != 0 )
          lineTree.Add(lines.Branch(i)[j], new GH_Path(i));

      }

    linesOut = lineTree;
# ---------- end rightcenterlines ----------
leftcenterlines = CSharpScript(lines=line_3)  # -> linesOut; inputs lines: tree of Line
# ---------- leftcenterlines: C# ----------
    var lineTree = new DataTree<Line>();

    for( int i = 0; i < lines.BranchCount; ++i )
      for( int j = 4; j < lines.Branch(i).Count; ++j )
      {

        if( i % 2 != 0 )
          lineTree.Add(lines.Branch(i)[j], new GH_Path(i));

      }

    linesOut = lineTree;
# ---------- end leftcenterlines ----------
leftintersectionrlines = CSharpScript(lines=line_3)  # -> linesOut; inputs lines: tree of Line
# ---------- leftintersectionrlines: C# ----------
    var lineTree = new DataTree<Line>();

    for( int i = 0; i < lines.BranchCount; ++i )
      for( int j = 3; j < lines.Branch(i).Count; ++j )
      {

        if( i % 2 != 1 )
          lineTree.Add(lines.Branch(i)[j], new GH_Path(i));

      }

    linesOut = lineTree;
# ---------- end leftintersectionrlines ----------
rigthintersectionrlines = CSharpScript(lines=line_3)  # -> linesOut; inputs lines: tree of Line
# ---------- rigthintersectionrlines: C# ----------
    var lineTree = new DataTree<Line>();

    for( int i = 0; i < lines.BranchCount; ++i )
      for( int j = 0; j < lines.Branch(i).Count - 3; ++j )
      {

        if( i % 2 != 1 )
          lineTree.Add(lines.Branch(i)[j], new GH_Path(i));

      }

    linesOut = lineTree;
# ---------- end rigthintersectionrlines ----------
list_item_4 = ListItem(List=flip_matrix_2, Index=0, Wrap=True)
list_item_5 = ListItem(List=flip_matrix_3, Index=1, Wrap=True)
list_item_6 = ListItem(List=flip_matrix_4, Index=0, Wrap=True)
list_item_7 = ListItem(List=flip_matrix_5, Index=1, Wrap=True)

# ---- group: SetupForKangaroo / SimulationReset
toggle = BooleanToggle(True)
reset = Button()

# ---- group: SetupForKangaroo / mesh of flat folding pattern
mesh = Mesh(mesh_join_2)

# ---- group: maintain edge lengths
medges = MeshEdges(Mesh=mesh)  # -> NakedEdges, InteriorEdges, NonManifoldEdges
length_line = LengthLine(Line=[medges.NakedEdges, medges.InteriorEdges], Strength=1)

# ---- group: a weak plastic anchor on all points prevents drift
demesh = DeconstructMesh(Mesh=mesh)  # -> Vertices, Faces, Colours, Normals
plasticanchor = PlasticAnchor(Point=demesh.Vertices, Limit=0.01, Strength=0.001)

# ---- group: AnchorPointsAlthoughWeDontNeedThemNoMore
join_curves = JoinCurves(Curves=leftintersectionrlines, Preserve=False)
join_curves_2 = JoinCurves(Curves=rigthintersectionrlines, Preserve=False)
end_points = EndPoints(Curve=join_curves)  # -> Start, End
end_points_2 = EndPoints(Curve=join_curves_2)  # -> Start, End
point = Point(end_points.End)
point_2 = Point(end_points_2.Start)

# ---- group: WeShouldntNeedThisOnes
load = Load(ForceVector=Vector(0, 0, 1))
point_3 = Point([point, point_2])
move_3 = Move(Geometry=graft(point_3), Motion=unit_y)  # -> Geometry, Transform
anchor = Anchor(Point=flatten(move_3.Geometry), Strength=1000)

# ---- group: SetupForKangaroo
curve_2 = Curve([centerlines, leftintersectionrlines, rigthintersectionrlines])
curve_3 = Curve([list_item_4, list_item_5, list_item_6, list_item_7, topbottomlines, rightcenterlines, leftcenterlines])
move_4 = Move(Geometry=graft(curve_2), Motion=unit_y)  # -> Geometry, Transform
move_5 = Move(Geometry=graft(curve_3), Motion=unit_y)  # -> Geometry, Transform
curve_4 = Curve(move_4.Geometry)
# You can replace the mesh with a different
# pattern, and choose edges from it to assign
# to mountain or valley folds.
valleys = Curve(flatten(curve_4))
folding = Slider(0.328, range=0..0.99)
angle = Panel("pi")
angle_2 = Panel("-pi")
rad = Radians(Degrees=Slider(-180, range=-360..360))
rad_2 = Radians(Degrees=Slider(45, range=-360..360))

# ---- group: SetupForKangaroo / WatchOut!ThisComponentHelpsToVisualizeIfTheNumberOnTheFirstParametersOnTheLeftIsOKOrNot
curve_5 = Curve([move_5.Geometry, curve])

# ---- group: SetupForKangaroo (continued)
mountains = Curve(flatten(curve_5))

# ---- group: SetupForKangaroo / Mountain fold lines
crv = Curve(mountains)

# ---- group: SetupForKangaroo / Valley fold lines
crv_2 = Curve(valleys)

# ----
hingepoints = HingePoints(Mesh=mesh)  # -> _1, _2, _3, _4
multiplication = Multiplication(A=angle, B=folding)
multiplication_2 = Multiplication(A=angle_2, B=folding)
ln = Line(StartPoint=hingepoints._1, EndPoint=hingepoints._2)
hinge = Hinge(
    FoldStart=hingepoints._1,
    FoldEnd=hingepoints._2,
    Tip1=hingepoints._3,
    Tip2=hingepoints._4,
    RestAngle=expr("-x", multiplication),
    Strength=0.1)
hinge_2 = Hinge(
    FoldStart=hingepoints._1,
    FoldEnd=hingepoints._2,
    Tip1=hingepoints._3,
    Tip2=hingepoints._4,
    RestAngle=expr("-x", multiplication_2),
    Strength=0.1)
show = Show(G=mesh)
eval = EvaluateCurve(Curve=reparameterize(crv_2), Parameter=0.5)  # -> Point, Tangent, Angle
eval_2 = EvaluateCurve(Curve=reparameterize(crv), Parameter=0.5)  # -> Point, Tangent, Angle
eval_3 = EvaluateCurve(Curve=ln, Parameter=0.5)  # -> graft(Point), Tangent, Angle
dist = Distance(PointA=eval.Point, PointB=eval_3.Point)
dist_2 = Distance(PointA=eval_2.Point, PointB=eval_3.Point)
sort = SortList(Keys=dist)  # -> Keys, ValuesA
sort_2 = SortList(Keys=dist_2)  # -> Keys, ValuesA
item = ListItem(List=sort.Keys, Index=0, Wrap=True)
item_2 = ListItem(List=sort_2.Keys, Index=0, Wrap=True)
smaller = SmallerThan(FirstNumber=item, SecondNumber=0.01)  # -> flatten(SmallerThan), OrEqualTo
smaller_2 = SmallerThan(FirstNumber=item_2, SecondNumber=0.01)  # -> flatten(SmallerThan), OrEqualTo
cull = CullPattern(List=hinge, CullPattern=smaller_2.SmallerThan)
cull_2 = CullPattern(List=hinge_2, CullPattern=smaller.SmallerThan)

# ---- group: Output
solver = Solver(GoalObjects=[length_line, cull_2, cull, show, plasticanchor], Reset=reset, Threshold=1e-15, Tolerance=0.01, On=toggle)  # -> I, V, O
onlymeshes = CSharpScript(x=solver.O)  # -> out, A; inputs x: tree
# ---------- onlymeshes: C# ----------
    var meshOut = new List<object>();

    for( int i = 0; i < x.BranchCount; ++i )
      for( int j = 0; j < x.Branch(i).Count; ++j )
      {
  
        if( x.Branch(i)[j] != null )
          
          if( x.Branch(i)[j].GetType() == typeof( Rhino.Geometry.Mesh ) )
        
            meshOut.Add(x.Branch(i)[j]);
  
      }

    A = meshOut;
# ---------- end onlymeshes ----------
